# Grasshopper definition areaNormaliser.gh (Grasshopper 0.9.62)

# ---- group: Inputs
target_area = Slider(51, range=-1..300)
crv = Curve(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)
crv_2 = Curve(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)
crv_3 = Curve(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)

# ----
area_norm = AreaNorm(G=crv_2, A=target_area)
area_norm_2 = AreaNorm(G=crv, A=target_area)
area_norm_3 = AreaNorm(G=crv_3, A=target_area)

# ---- group: outputs
area = Area(Geometry=area_norm)  # -> Area, Centroid
area_2 = Area(Geometry=area_norm_3)  # -> Area, Centroid
area_3 = Area(Geometry=area_norm_2)  # -> Area, Centroid
tag = TextTag(Location=area_3.Centroid, Text=area_3.Area)
tag_2 = TextTag(Location=area_2.Centroid, Text=area_2.Area)
tag_3 = TextTag(Location=area.Centroid, Text=area.Area)

# ==== cluster AreaNorm
G = ClusterInput()
A = ClusterInput()
area = Area(Geometry=G)  # -> Area, Centroid
# http://www.av8n.com/physics/scaling.htm
# the ratio of areas goes like the second power of the ratio of lengths. Equivalently, you can say that the ratio of areas goes like the square of the ratio of lengths.
# 
# (ratio of areas) = (ratio of lengths)2
division = Division(A=A, B=area.Area)
sqrt = SquareRoot(Value=division)
scale = Scale(Geometry=G, Center=area.Centroid, Factor=sqrt)  # -> Geometry, Transform
G_2 = ClusterOutput(scale.Geometry)
area_2 = Area(Geometry=scale.Geometry)  # -> Area, Centroid
