# Grasshopper definition to_gd_lvl.gh (Grasshopper 0.9.62)
# plug-ins: Python Interpreter

ground_mesh = MeshA(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)
crv = Curve([<curve referenced from the Rhino model> x5])
crv_2 = Curve([<curve referenced from the Rhino model> x5])
curve = Curve([<curve referenced from the Rhino model> x2])
flip = FlipCurve(Curve=crv)  # -> Curve, Flag
glf = GLF(groundmesh=ground_mesh, curve=curve)  # -> crv_at_ground_level_2, ground_level_pl_2
crv_3 = Curve(flatten([flip.Curve, crv_2]))
python = PythonScript(x=crv_3)  # -> out, a; inputs x: list of Curve
# ---------- python: Python ----------
import rhinoscriptsyntax as rs
import sys
import math 

def distance3d(p1,p2):
    squared = (p2.X-p1.X)**2 + (p2.Y-p1.Y)**2 + (p2.Z-p1.Z)**2
    dist = math.sqrt(squared)
    return dist

def closest(me, cloud):
    closestDist = sys.maxint
    closestPt = None
    
    for p in cloud:
        if p != me:
            dist = distance3d(me,p)
            if dist < closestDist:
                closestDist = dist
                closestPt = p
    return closestPt

curves    = []
allPoints = []

for c in x:
    curves.append(c)
    allPoints.append( rs.CurveEndPoint(c) )
    allPoints.append( rs.CurveStartPoint(c) )




while allPoints != []:
    s = allPoints.pop()
    print s
    allPoints.remove(s)           #remove the search point
    endPt = closest(s, allPoints) #find the closest point to s
    line = rs.AddLine(s, endPt)   #draw a line between those points
    print distance3d(s,endPt)
    curves.append(line)
    #allPoints.remove(endPt)



a = curves
# ---------- end python ----------
end = EndPoints(Curve=python.a)  # -> Start, End
join = JoinCurves(Curves=python.a, Preserve=False)
panel = Panel(glf.ground_level_pl_2)
panel_2 = Panel(glf.crv_at_ground_level_2)
close = Close(C=join)  # disabled
crv_4 = Curve(close)  # disabled

# ==== cluster GLF
curve = ClusterInput()
groundmesh = ClusterInput()
curve_2 = Curve(curve)
maxint = Maxint()
Z = UnitZ(Factor=maxint)
extr = Extrude(Base=curve_2, Direction=Z)
number_slider = Slider(1000, range=0..1000)
mesh = MeshBrep(
    Brep=extr,
    Settings={GridMaxCount=0, GridMinCount=16, JaggedSeams=False, MaxEdgeLength=0, MinEdgeLength=0.0001, MinTolerance=0, Refine=True, RefineAngle=0, RelativeTolerance=0.65, SimplePlanes=True, Tolerance=0})
mmx = MeshMesh(GroundMesh=groundmesh, MeshB=mesh, UseMeshMeshFast=True)
curves = Curve(mmx)
end = EndPoints(Curve=curves)  # -> Start, End
healcurves = HealCurves(curves=curves)
box = CenterBox(Base=end.End, X=number_slider, Y=number_slider, Z=number_slider)
sph = Sphere(Base=end.Start, Radius=number_slider)
crv = Curve(healcurves)
python = PythonScript(x=curves)  # -> out, a; inputs x: list of Curve
# ---------- python: Python ----------
import rhinoscriptsyntax as rs
import sys
import math 

def distance3d(p1,p2):
    squared = (p2.X-p1.X)**2 + (p2.Y-p1.Y)**2 + (p2.Z-p1.Z)**2
    dist = math.sqrt(squared)
    return dist

def closest(to, cloud):
    closestDist = sys.maxint
    closestPt = None
    for p in cloud:
        dist = distance3d(to,p)
        if dist < closestDist:
            closestDist = dist
            closestPt = p
    return closestPt


curves = []
curves.append(x)

starts = []
ends   = []

for c in x:
    ends.append( rs.CurveEndPoint(c) )
    starts.append( rs.CurveStartPoint(c) )
    
for s in starts:
    endPt = closest(s, ends)
    line = rs.AddLine(s,endPt)
    curves.append(line)
    ends.remove(endPt)
    print endPt

a = curves
# ---------- end python ----------
centroid = Centroid(C=mmx)
xy = XYPlane(Origin=centroid)
project = Project(Geometry=curve_2, Plane=xy)  # -> Geometry, Transform
ground_level_pl = Plane(xy)
crv_at_ground_level = Curve(project.Geometry)
crv_at_ground_level_2 = ClusterOutput(crv_at_ground_level)
ground_level_pl_2 = ClusterOutput(ground_level_pl)

# ==== cluster Close
C = ClusterInput()
end = EndPoints(Curve=C)  # -> Start, End
ln = Line(StartPoint=end.Start, EndPoint=end.End)
join = JoinCurves(Curves=ln, Preserve=False)
C_2 = ClusterOutput(join)

# ==== cluster Centroid
C = ClusterInput()
cp = ControlPoints(Curve=C)  # -> flatten(Points), Weights, Knots
ma = MassAddition(Input=cp.Points)  # -> Result, PartialResults
lng = ListLength(List=cp.Points)
division = Division(A=ma.Result, B=lng)
R = ClusterOutput(division)

# ==== cluster Maxint
num = Number(1e+32)
num_2 = ClusterOutput(num)
panel = Panel(num)

# ==== cluster HealCurves
curves = ClusterInput()
curves_2 = Curve(curves)
end = EndPoints(Curve=curves_2)  # -> Start, End
cp = ClosestPoint(Point=end.Start, Cloud=end.End)  # -> ClosestPoint, CPIndex, Distance
ln = Line(StartPoint=end.Start, EndPoint=cp.ClosestPoint)
join = JoinCurves(Curves=[curves_2, ln], Preserve=False)
healedcurve = ClusterOutput(join)
