# Grasshopper definition veryBasicHTMLtemplate.gh (Grasshopper 0.9.62)
# plug-ins: Python Interpreter

body = Panel("""<div class="container">
  <div class="row">
    <div class="col-md-6">
    
      <h1>Option {optNum}</h1>
      <img src="{imgName}.jpg" class="img-responsive pull-right" alt="Grabbed from a Rhino viewport">
      <p>570 George Street site only<br>
      Floor to floor height {f2f}m</p>
      
      <p>Rear setback and Meriton st {meritonSetback}m<br>
      George Street Setback {georgeSetback}m</p>
      
      <p>Residential & possible hotel
      <br>Ground floor hotel
      <br>Basement carpark (existing)</p>
      
      <p>Assume <abbr title="whatever FSR stands for">FSR</abbr> {fsr}</p>
      
      <h2>Areas</h2>
      <p><span class='area-label'>Site area</span><span class='area-result'> = {siteArea}m&sup2;</span></p>
      <p><span class='area-label'>Allowable <abbr title="Gross floor area">GFA</abbr></span><span class='area-result'> = {allowableGFA}m&sup2;</span></p>
      
      <h3>Estimated total <em>allowable</em> areas<a href="#" title="Does not include balconies">**</a></h3>
      <p><span class='area-label'><abbr title="Gross building area">GBA</abbr></span><span class='area-result'> = {estAllowableGBA}m&sup2;</span></p>
      <p><span class='area-label'><abbr title="Gross floor area">GFA</abbr></span><span class='area-result'>       = {estAllowableGFA}m&sup2;</span></p>
      <p><span class='area-label'><abbr title="Net lettable area">NLA</abbr></span><span class='area-result'>     = {estAllowableNLA}m&sup2;</span></p>
      
      <h3>Estimated total <em>new floorplate</em> areas<a href="#" title="Does not include balconies">**</a></h3>
      <p><span class='area-label'><abbr title="Gross building area">GBA</abbr></span><span class='area-result'> = [a bunch of data goes in here perhaps?] {estNewFloorplateGBA}m&sup2;</span></p>
      <p><span class='area-label'><abbr title="Gross floor area">GFA</abbr></span><span class='area-result'>       = [a bunch of data goes in here perhaps?] {estNewFloorplateGFA}m&sup2;</span></p>
      <p><span class='area-label'><abbr title="Net lettable area">NLA</abbr></span><span class='area-result'>     = [a bunch of data goes in here perhaps?] {estNewFloorplateNLA}m&sup2;</span></p>
      
      <h3>Estimated total <em>podium</em> areas<a href="#" title="Does not include balconies">**</a></h3>
      <p><span class='area-label'><abbr title="Gross building area">GBA</abbr></span><span class='area-result'> = {estPodiumGBA}m&sup2;</span></p>
      <p><span class='area-label'><abbr title="Gross floor area">GFA</abbr></span><span class='area-result'>       = {estPodiumGFA}m&sup2;</span></p>
      <p><span class='area-label'><abbr title="Net lettable area">NLA</abbr></span><span class='area-result'>     = {estPodiumNLA}m&sup2;</span></p>
      
      <h2>residential efficiency estimates</h2>
      <p><span class='area-label'><abbr title="Gross Floor area">GFA</abbr></span><span class='area-result'>     = {estResEffGFA}%</span></p>
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""")
panel = Panel("""<!DOCTYPE html>
<html lang="en">
<head>""")
header = Panel("""<script src="http://ajax.googleapis.com/ajax/libs/jquery/1.10.2/jquery.min.js"></script>

<script src="http://netdna.bootstrapcdn.com/bootstrap/3.0.1/js/bootstrap.min.js"></script>

<link rel="stylesheet" type="text/css" href="http://netdna.bootstrapcdn.com/bootstrap/3.0.1/css/bootstrap.min.css" />

<style>
.area-label{
  display: inline-block;
  width: 7em;
  text-align: right;
}
</style>""")
panel_2 = Panel("""</head>
<body>""")
panel_3 = Panel("""</body>
</html>""")
allowable_gfa = Panel("332777.5")

est_allowable_gba = Panel("332777.5")
est_allowable_nla = Panel("332777.5")
est_allowable_gfa = Panel("332777.5")
sep = Sep(x=est_allowable_gba)
sep_2 = Sep(x=est_allowable_gfa)
sep_3 = Sep(x=est_allowable_nla)

est_new_floorplate_gba = Panel("332777.5")
est_new_floorplate_gfa = Panel("332777.5")
est_new_floorplate_nla = Panel("332777.5")
sep_4 = Sep(x=est_new_floorplate_gba)
sep_5 = Sep(x=est_new_floorplate_gfa)
sep_6 = Sep(x=est_new_floorplate_nla)

est_podium_gba = Panel("332777.5")
est_podium_gfa = Panel("332777.5")
est_podium_nla = Panel("332777.5")
sep_7 = Sep(x=est_podium_gba)
sep_8 = Sep(x=est_podium_gfa)
sep_9 = Sep(x=est_podium_nla)

appt_data = Panel("""Studio
10
38-40
64
(0.1) 6.4
0""")
appt_data_2 = Panel("""1 Bedroom
10
38-40
64
(0.1) 6.4
0""")
appt_data_3 = Panel("""2 Bedroom
10
38-40
64
(0.1) 6.4
0""")
appt_data_4 = Panel("""3+Bedroom
10
38-40
64
(0.1) 6.4
0""")

pros = Panel("""really nice
yum
very flattering
great shoes""")
pros_2 = Panel("""Poo
wee
arse""")
notes = Panel("""Poo
wee
arse""")

residential_efficiency_estimate_nla = Panel("85")
residential_efficiency_estimate_gfa = Panel("83")

image_name = Panel("image1")
option_number = Panel("3B ii")
option_number_2 = Panel("3.1")
meriton_setback = Panel("6")
george_st_setback = Panel("7.6")
fsr = Panel("15.3:1")
site_area = Panel("2175")
slider = Slider(43, range=0..1000)
sep_10 = Sep(x=allowable_gfa)
html_list = HtmlList(x=pros)
html_list_2 = HtmlList(x=pros_2)
html_list_3 = HtmlList(x=notes)
dam = DataDam(DataA=slider, BufferDelay=20000000, BufferMode=2)
sph = Sphere(Base=PlaneXY(0, 0, 0), Radius=slider)
save_image = PythonScript(x=image_name, trig=dam)  # -> out, a
# ---------- save_image: Python ----------
import rhinoscriptsyntax as rs
rs.SendKeystrokes('-viewcapturetofile')
rs.SendKeystrokes('C:\\Users\\bdoherty\\Desktop\\testghwebsite\\'+str(x)+'.jpg')
rs.SendKeystrokes('')
# ---------- end save_image ----------
string_interpolater = PythonScript(
    bodyString=body,
    imgName=image_name,
    optNum=option_number,
    f2f=option_number_2,
    meritonSetback=meriton_setback,
    georgeSetback=george_st_setback,
    fsr=fsr,
    siteArea=site_area,
    allowableGFA=sep_10,
    estAllowableGBA=sep,
    estAllowableGFA=sep_2,
    estAllowableNLA=sep_3,
    estNewFloorplateGBA=sep_4,
    estNewFloorplateGFA=sep_5,
    estNewFloorplateNLA=sep_6,
    estPodiumGBA=sep_7,
    estPodiumGFA=sep_8,
    estPodiumNLA=sep_9,
    estResEffGFA=residential_efficiency_estimate_gfa,
    estResEffNLA=residential_efficiency_estimate_nla,
    apptData1=appt_data,
    apptData2=appt_data_2,
    apptData3=appt_data_3,
    apptData4=appt_data_4,
    pros=html_list,
    cons=html_list_2,
    notes=html_list_3)  # -> out, a; inputs apptData1: list, apptData2: list, apptData3: list, apptData4: list
# ---------- string_interpolater: Python ----------
import rhinoscriptsyntax as rs

a = bodyString.format(**locals())
# ---------- end string_interpolater ----------
merge = Merge(Data1=panel, Data2=header, Data3=panel_2, Data4=string_interpolater.a, Data5=panel_3)
panel_4 = Panel(merge)

# ==== cluster Sep
x = ClusterInput()
add_thousand_seps = PythonScript(x=x)  # -> out, a
# ---------- add_thousand_seps: Python ----------
import locale
locale.setlocale(locale.LC_ALL, 'en_AU')
a = locale.format("%d", x, grouping=True)
print a
# ---------- end add_thousand_seps ----------
a = ClusterOutput(add_thousand_seps.a)

# ==== cluster HtmlList
x = ClusterInput()
html_list = PythonScript(x=x)  # -> out, a; inputs x: list
# ---------- html_list: Python ----------
theHTML = "<ul>"
for thing in x:
    theHTML += "<li>"+thing+"</li>"
theHTML += "</ul>"

a = theHTML
# ---------- end html_list ----------
a = ClusterOutput(html_list.a)
