# Grasshopper definition heal_broken_curve.gh (Grasshopper 0.9.62)

crv = Curve([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])
crv_2 = Curve([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])
flip = FlipCurve(Curve=crv)  # -> Curve, Flag
crv_3 = Curve(flatten([flip.Curve, crv_2]))
heal = Heal(x=crv_3)
panel = Panel(heal)

# ==== cluster Heal
x = ClusterInput()
python = PythonScript(x=x)  # -> out, a; inputs x: list of Curve
# ---------- python: Python ----------
import rhinoscriptsyntax as rs
import sys
import math 

def distance3d(p1,p2):
    squared = (p2.X-p1.X)**2 + (p2.Y-p1.Y)**2 + (p2.Z-p1.Z)**2
    dist = math.sqrt(squared)
    return dist

def closest(me, cloud):
    closestDist = sys.maxint
    closestPt = None
    
    for p in cloud:
        if p != me:
            dist = distance3d(me,p)
            if dist < closestDist:
                closestDist = dist
                closestPt = p
    return closestPt

curves    = []
allPoints = []

for c in x:
    curves.append(c)
    allPoints.append( rs.CurveEndPoint(c) )
    allPoints.append( rs.CurveStartPoint(c) )


while len(allPoints)>1:
    print len(allPoints)
    s = allPoints.pop()           #remove the search point
    print s
    endPt = closest(s, allPoints) #find the closest point to s
    line = rs.AddLine(s, endPt)   #draw a line between those points
    print distance3d(s,endPt)
    curves.append(line)
    allPoints.remove(endPt)

a = curves
# ---------- end python ----------
join = JoinCurves(Curves=python.a, Preserve=False)
C = ClusterOutput(join)
