# Grasshopper definition LOS.gh (Grasshopper 0.9.62)
# plug-ins: Python Interpreter, LunchBox

# ---- group: giant sphere
pt = Point(<point referenced from the Rhino model>)
z_mod = ZMod(P=pt, Z=Slider(25, range=0..25))
sph = Sphere(Base=z_mod, Radius=Slider(9, range=0..10))

# ----
crv = Curve(<curve referenced from the Rhino model>)
viewing_surfaces = Surface([<surface referenced from the Rhino model> x7])

# ---- group: quads
qgrid = QuadGrid(Surface=viewing_surfaces, UDivisions=Slider(9, range=0..10), VDivisions=Slider(9, range=0..10))  # -> CornerPoint1, CornerPoint2, CornerPoint3, CornerPoint4, MidPoint, Normals
srf4pt = _4PointSurface(CornerA=qgrid.CornerPoint1, CornerB=qgrid.CornerPoint2, CornerC=qgrid.CornerPoint3, CornerD=qgrid.CornerPoint4)  # -> flatten(Surface)

# ----
obstructing_surfaces = Surface(flatten([sph, viewing_surfaces]))
divide = DivideCurve(Curve=crv, Count=Slider(20, range=2..50), Kinks=False)  # -> Points, Tangents, Parameters
Z = UnitZ(Factor=1)
move = Move(Geometry=qgrid.MidPoint, Motion=Z)  # -> flatten(Geometry), Transform
quant_obstruction = QuantObstruction(obstructing_surfaces=obstructing_surfaces, targets=divide.Points, eyes=move.Geometry)  # -> obstructed_count_2, ray_count_2
division = Division(A=quant_obstruction.obstructed_count_2, B=quant_obstruction.ray_count_2)
lim = Y(1)
clip_val = PythonScript(x=division, lim=lim)  # -> out, a
# ---------- clip_val: Python ----------
if x>lim:
    a=lim
else:
    a=x
# ---------- end clip_val ----------
hsl = ColourHSL(Alpha=1, Hue=expr("0.6-(H*0.6)", clip_val.a), Saturation=1, Luminance=0.5)  # -> flatten(Colour)
preview = CustomPreview(Geometry=srf4pt, Shader=hsl)

# ==== cluster QuantObstruction
obstructing_surfaces = ClusterInput()
targets = ClusterInput()
eyes = ClusterInput()
targets_2 = Point(targets)
eyes_2 = Point(eyes)
obstructing_surfaces_2 = Surface(obstructing_surfaces)
ln = Line(StartPoint=graft(eyes_2), EndPoint=targets_2)
# This doesn't give a perfect measure of obstruction becasue it allows for multiple counts where a ray intersects more than one surface etc.
# 
# This should eventually be fixed but is of reasonably low priority
bcx = BrepCurve(Brep=obstructing_surfaces_2, Curve=graft(ln))  # -> Curves, Points
path_mapper = PathMapper(bcx.Points, source="{A;B;C;D}", target="{B}")
lng = ListLength(List=path_mapper)
lng_2 = ListLength(List=ln)  # -> simplify(Length)
obstructed_count = Integer(lng)
ray_count = Integer(lng_2)
obstructed_count_2 = ClusterOutput(obstructed_count)
ray_count_2 = ClusterOutput(ray_count)

# ==== cluster ZMod
P = ClusterInput()
pdecon = Deconstruct(Point=P)  # -> XComponent, YComponent, ZComponent
Z = ClusterInput()
pt = ConstructPoint(XCoordinate=pdecon.XComponent, YCoordinate=pdecon.YComponent, ZCoordinate=expr("16-Z", Z))
pt_2 = ClusterOutput(pt)
